# Dynamo graph script.dyn "save excel" (Dynamo 2.12.0.5650)

code_block = CodeBlock { false; }
python_script = Python()  # IronPython2; unwired: IN[0]
# ---------- python_script.python (14 lines) ----------
#Copyright(c) 2016, Dimitar Venkov
# @5devene, dimitar.ven@gmail.com

import clr

clr.AddReference("RevitServices")
import RevitServices
from RevitServices.Persistence import DocumentManager
doc = DocumentManager.Instance.CurrentDBDocument
clr.AddReference("RevitNodes")
import Revit
clr.ImportExtensions(Revit.Elements)

OUT = doc.ActiveView.ToDSType(True)
# ----------------------------------------
type = Object.Type(object=python_script)
code_block_2 = CodeBlock { "Revit.Elements.Views.ScheduleView"; }
eq = type == code_block_2
code_block_3 = CodeBlock { "Please open a schedule first."; }
if_ = RefactoredIf(test=eq, true=python_script, false=code_block_3)
python_script_2 = Python(IN[0]=if_)  # IronPython2
# ---------- python_script_2.python (9 lines) ----------
import clr
clr.AddReference("RevitAPIUI")
from Autodesk.Revit.UI import *

if isinstance(IN[0], basestring):
	TaskDialog.Show("Title", IN[0])
	OUT = False
else:
	OUT = True
# ----------------------------------------
python_script_3 = Python(IN[0]=python_script_2)  # IronPython2
# ---------- python_script_3.python (18 lines) ----------
import clr
import sys
import System
clr.AddReference('System.Windows.Forms')
clr.AddReference('System.Drawing')
clr.AddReference('System')

from System.Drawing import Point, Font
from System.Windows.Forms import SaveFileDialog

openDialog = SaveFileDialog()
openDialog.Filter = "All files|*.xlsx"

if IN[0] == True:
	openDialog.ShowDialog()
	OUT = openDialog.FileName
else:
	OUT = False
# ----------------------------------------
code_block_4 = CodeBlock { false; }
fileName = FileSystem.FileName(path=python_script_3, withExtension=code_block_4)
code_block_5 = CodeBlock { 1; }
code_block_6 = CodeBlock { 0; }
python_script_4 = Python(IN[0]=if_)  # IronPython2
# ---------- python_script_4.python (45 lines) ----------
#Copyright 2016. All rights reserved. Bimorph Consultancy LTD, 5 St Johns Lane, London EC1M 4BH www.bimorph.co.uk
#Written by Thomas Mahon @Thomas__Mahon info@bimorph.co.uk

import clr
clr.AddReference('ProtoGeometry')
from Autodesk.DesignScript.Geometry import *

# Import DocumentManager and TransactionManager
clr.AddReference("RevitServices")
import RevitServices
from RevitServices.Persistence import DocumentManager
from RevitServices.Transactions import TransactionManager
from System.Collections.Generic import *
#
# Import RevitAPI
clr.AddReference("RevitAPI")
import Autodesk
from Autodesk.Revit.DB import *

doc = DocumentManager.Instance.CurrentDBDocument
uiapp = DocumentManager.Instance.CurrentUIApplication
app = uiapp.Application

schedule = UnwrapElement(IN[0])

# "Start" the transaction
TransactionManager.Instance.EnsureInTransaction(doc)
		
#count the number of rows and columns in the schedule
table = schedule.GetTableData().GetSectionData(SectionType.Body)
nRows = table.NumberOfRows
nColumns = table.NumberOfColumns

#Collect all of data from the schedule
dataListRow = []
for row in range(nRows): #Iterate through the rows. The second row is always a blank space
	dataListColumn = []
	for column in range(nColumns): #Iterate through the columns
		dataListColumn.Add( TableView.GetCellText(schedule, SectionType.Body, row, column) )
	dataListRow.Add( dataListColumn );

# "End" the transaction
TransactionManager.Instance.TransactionTaskDone()

OUT = dataListRow
# ----------------------------------------
code_block_7 = CodeBlock(l1=python_script_4) { List.DropItems(List.DropItems(l1,3),-1); l1[[0,1,-1]]; }
watch = Watch(code_block_7.out0)
python_script_5 = Python(IN[0]=python_script_3, IN[1]=fileName, IN[2]=code_block_5, IN[3]=code_block_6, IN[4]=watch, IN[5]=python_script_2)  # IronPython2
# ---------- python_script_5.python (49 lines) ----------
import clr
import sys
sys.path.append('C:\Program Files (x86)\IronPython 2.7\Lib')
import System
from System import Array
from System.Collections.Generic import List as IList
clr.AddReference('ProtoGeometry')
from Autodesk.DesignScript.Geometry import *
clr.AddReference("RevitNodes")
import Revit
clr.ImportExtensions(Revit.Elements)
clr.ImportExtensions(Revit.GeometryConversion)
clr.AddReference("RevitServices")
import RevitServices
from RevitServices.Persistence import DocumentManager 
from RevitServices.Transactions import TransactionManager 

clr.AddReference("RevitAPI")
clr.AddReference("RevitAPIUI")

import Autodesk 
from Autodesk.Revit.DB import *
from Autodesk.Revit.UI import *

doc = DocumentManager.Instance.CurrentDBDocument
uiapp = DocumentManager.Instance.CurrentUIApplication 
app = uiapp.Application 
uidoc = uiapp.ActiveUIDocument

clr.AddReference("DSOffice")
import DSOffice
from DSOffice import *

filePath = IN[0]
sheetName = IN[1]
startRow = IN[2]
startCol = IN[3]
data = IN[4]
overWrite = False

list = []
for l in data:
	list.append(Array[object](l))

list2 = Array[object](list)	
list3 = Array[Array[object]](list2)

if IN[5] == True:
	DSOffice.Data.ExportExcel(filePath, sheetName, startRow, startCol, list3, overWrite)
# ----------------------------------------
code_block_8 = CodeBlock { ""; }
count = List.Count(list=watch@L2)
code_block_9 = CodeBlock { 50; }
add = count + code_block_9
cycle = List.Cycle(list=code_block_8, amount=add)
code_block_10 = CodeBlock { 5; }
cycle_2 = List.Cycle(list=cycle, amount=code_block_10)
python_script_6 = Python(IN[0]=python_script_3, IN[1]=fileName, IN[2]=code_block_5, IN[3]=code_block_6, IN[4]=cycle_2, IN[5]=python_script_2)  # IronPython2; same code as python_script_5
