# Dynamo graph script.dyn "CountHiddenElementsInView" (Dynamo 2.12.0.5650)

refresh = BoolSelector(false)
get_hidden_elements_ids = Python(IN[0]=refresh)  # IronPython2
# ---------- get_hidden_elements_ids.python (31 lines) ----------
## Create by https://rv-boost.com/
import clr
clr.AddReference('ProtoGeometry')
from Autodesk.DesignScript.Geometry import *
# Import ToDSType(bool) extension method
clr.AddReference("RevitNodes")
import Revit
clr.ImportExtensions(Revit.Elements)
# Import geometry conversion extension methods
clr.ImportExtensions(Revit.GeometryConversion)
# Import DocumentManager and TransactionManager
clr.AddReference("RevitServices")
import RevitServices
from RevitServices.Persistence import DocumentManager
from RevitServices.Transactions import TransactionManager
from System.Collections.Generic import *
# Import RevitAPI
clr.AddReference("RevitAPI")
import Autodesk
from Autodesk.Revit.DB import *
from Autodesk.Revit.DB.Architecture import *

doc = DocumentManager.Instance.CurrentDBDocument
view = doc.ActiveView
hiddenIds = List[ElementId]()

for elem in FilteredElementCollector(doc).WhereElementIsNotElementType():
	if elem.IsHidden(view):
		hiddenIds.Add(elem.Id)
		
OUT = hiddenIds
# ----------------------------------------
count = List.Count(list=get_hidden_elements_ids)
