# Dynamo graph script.dyn "UnhideElementsInView" (Dynamo 2.12.0.5650)

refresh = BoolSelector(false)
unhide_all_objects_hidden_in = Python(IN[0]=refresh)  # "Unhide all objects hidden in view "By Element""; IronPython2
# ---------- unhide_all_objects_hidden_in.python (44 lines) ----------
## Create by https://rv-boost.com/
import clr
clr.AddReference('ProtoGeometry')
from Autodesk.DesignScript.Geometry import *
# Import ToDSType(bool) extension method
clr.AddReference("RevitNodes")
import Revit
clr.ImportExtensions(Revit.Elements)
# Import geometry conversion extension methods
clr.ImportExtensions(Revit.GeometryConversion)
# Import DocumentManager and TransactionManager
clr.AddReference("RevitServices")
import RevitServices
from RevitServices.Persistence import DocumentManager
from RevitServices.Transactions import TransactionManager
from System.Collections.Generic import *
# Import RevitAPI
clr.AddReference("RevitAPI")
import Autodesk
from Autodesk.Revit.DB import *
from Autodesk.Revit.DB.Architecture import *

doc = DocumentManager.Instance.CurrentDBDocument
view = doc.ActiveView
hiddenIds = List[ElementId]()

for elem in FilteredElementCollector(doc).WhereElementIsNotElementType():
	if elem.IsHidden(view):
		hiddenIds.Add(elem.Id)

if hiddenIds.Count > 0:		
	TransactionManager.Instance.ForceCloseTransaction()
	with Transaction(doc, "Unhide all in view") as transaction:
		transaction.Start()
		view.UnhideElements(hiddenIds)
		transaction.Commit()

revealed = []
for id in hiddenIds:
	e = doc.GetElement(id)
	if e:
		revealed.append(e)
		
OUT = revealed
# ----------------------------------------
revealed_elements = Watch(unhide_all_objects_hidden_in)
